# Grasshopper definition forma-api.gh (Grasshopper 1.0.7)
# Copyright: 2020
# plug-ins: Swiftlet, jSwan, Formicae, ShapeDiverForGrasshopper

sddp = ShapeDiverDocumentPayload({AbsoluteTolerance=0, AngleTolerance=0, DistanceDisplayPrecision=0, GltfVersion="Gltf2", GrasshopperVersion="1.0.0007", InputGroups="{}", OutputGroups="{}", RelativeTolerance=0, RhinoVersion="7.31.23166.15001", UnitSystem=0, VersionCreated="1.16.0.0", VersionSaved="1.16.0.0"})
list = ValueList({"lawson_lddcv": "lawson_lddc", "davenport", "lawson", "lawson_2001", "nen8100", "cstb"}, selected="lawson_lddcv")
click_to_authenticate = Button()
pipeline = GeometryPipeline(
    GroupByLayer=False,
    GroupByType=False,
    IncludeHidden=True,
    IncludeLocked=True,
    LayerFilter="Forma::Terrain",
    NameFilter="*",
    SublayerFiltering=True,
    TypeFilter=32)
pipeline_2 = GeometryPipeline(
    GroupByLayer=False,
    GroupByType=False,
    IncludeHidden=True,
    IncludeLocked=True,
    LayerFilter="Forma::Buildings",
    NameFilter="*",
    SublayerFiltering=True,
    TypeFilter=1073741880)
auth = Auth(Trigger=click_to_authenticate)
dam = DataDam(DataA=auth, BufferDelay=10000000, BufferMode=0)
clean = CleanTree(RemoveNulls=True, RemoveInvalid=True, RemoveEmpty=False, Tree=dam)
mesh = Mesh([pipeline_2, pipeline])
data = Data(flatten(clean))
python = GhPythonScript()  # -> out, endPoint
# ---------- python: Python ----------
__author__ = "ARZE"
__version__ = "2024.02.14"

import rhinoscriptsyntax as rs
ghenv.Component.Message = "Wind params end point"
endPoint  = "https://developer.api.autodesk.com/forma/wind-prediction/v1alpha/parameters"
# ---------- end python ----------
python_2 = GhPythonScript()  # -> out, key, value
# ---------- python_2: Python ----------
import rhinoscriptsyntax as rs

ghenv.Component.Message = "authcontext"
url = "https://app.autodeskforma.eu/designmode/pro_74nzjy4r4h/03ac9e63-182e-41b2-b5af-81e7b3ee2088"
urlParts = url.split("/")


key = "authcontext"
value = urlParts[-2]
# ---------- end python_2 ----------
python_3 = GhPythonScript()  # -> out, key, value
# ---------- python_3: Python ----------
import rhinoscriptsyntax as rs

ghenv.Component.Message = "x-ads-region"


key = "x-ads-region"
value = "EMEA"
# ---------- end python_3 ----------
bearer = BearerTokenAuth(Token=data)
cqp = CreateQueryParam(Key=python_2.key, Value=python_2.value)
ch = CreateHttpHeader(Key=python_3.key, Value=python_3.value)
mjoin = MeshJoin(Meshes=mesh)
merge = Merge(Data1=bearer, Data2=ch)
fg_ta = GH_terrainArrays(Terrain=pipeline, TerrainBuilding=mjoin)  # -> HeightDictionary, AnalysisMesh
get = GETRequest(URL=python.endPoint, Params=cqp, Headers=merge)  # -> Status, Content, Response
gh_postarray = GH_postArray(HeightArray=fg_ta.HeightDictionary, WindParameters=get.Content, WindcomfortClass=list)
ctb = CreateTextBody(
    Content=gh_postarray,
    IsHtmlChecked=False,
    IsJavascriptChecked=False,
    IsJsonChecked=True,
    IsTextChecked=False,
    IsXmlChecked=False)
python_4 = GhPythonScript()  # -> out, endPoint
# ---------- python_4: Python ----------
__author__ = "ARZE"
__version__ = "2024.02.14"

import rhinoscriptsyntax as rs
ghenv.Component.Message = "Predict end point"
#endPoint  = "https://developer.api.autodesk.com/forma/wind-prediction/v1alpha/predict"
endPoint = "https://developer.api.autodesk.com/forma/wind-prediction/v1alpha/comfort/predict"
# ---------- end python_4 ----------
merge_2 = Merge(Data1=bearer, Data2=ch)
post = POSTRequest(URL=python_4.endPoint, Body=ctb, Params=cqp, Headers=merge_2)  # -> Status, Content, Response
dejson = DeserializeJson(JSON=post.Content, OutputsLocked=False)  # -> Heatmap_data, Heatmap_mask, Metadata
prob = Data(fg_ta.AnalysisMesh)
meshrecolor = MeshReColor(Mesh=prob, Values=dejson.Heatmap_data, MaxValue=4)
